% Simulink data dictionary EstimatorsDictionary.sldd
% references CellDictionary.sldd

Ts = Simulink.Parameter(1)
soc_estim_init = Simulink.Parameter(0.5)
initial_covariance = Simulink.Parameter([0.2 1.0e-7 1.0e-6 1.0e-5])
state_covariance = Simulink.Parameter([1.0e-10 0 0 0; 0 1.0e-7 0 0; 0 0 1.0e-6 0; 0 0 0 1.0e-5])
measurement_covariance = Simulink.Parameter(0.0001)
cap_initial_covariance = Simulink.Parameter(1.0e-8)
cap_measurement_covariance = Simulink.Parameter(5.0e-7)
cap_process_covariance = Simulink.Parameter(3.0e-6)
cap_forgetting_factor = Simulink.Parameter(0.9)
cap_soc_change_threshold = Simulink.Parameter(0.05)
cap_current_measurement_variance = Simulink.Parameter(1.0e-8)