% Simulink data dictionary TestDictionary.sldd
% references EstimatorsDictionary.sldd

cycling_N_cycles = Simulink.Parameter([0 10 20 30 40 50])  % Number of cycles
cycling_OCV_change = Simulink.Parameter(repmat(0, 1, 6))  % OCV change from cycling
cycling_R0_change = Simulink.Parameter(repmat(0, 1, 6))  % R0 change from cycling
cycling_R1_change = Simulink.Parameter(repmat(0, 1, 6))  % R1 change from cycling
cycling_R2_change = Simulink.Parameter(repmat(0, 1, 6))  % R2 change from cycling
cycling_R3_change = Simulink.Parameter(repmat(0, 1, 6))  % R3 change from cycling
cycling_Q_change = Simulink.Parameter([0 -12 -18 -21 -23 -24])  % Capacity change from cycling
h_conv = Simulink.Parameter(5, Unit="W/m^2*K")  % Convection coefficient
T_init = Simulink.Parameter(298.15)
soc_init = Simulink.Parameter(0.2)
upper_soc = Simulink.Parameter(0.95)
lower_soc = Simulink.Parameter(0.05)